# Grasshopper definition 600_assembly_planner.ghx (Grasshopper 1.0.7)

# ----
# INPUT
# ROS
connect = BooleanToggle(True)
load_robot = BooleanToggle(True)
ros = ROSConnect(connect=connect)  # -> ros_client, is_connected; inputs port: Int32, connect: Boolean
#   port ip: The ip address ROS. Defaults to 127.0.0.1.
#   port port: The port of ROS. Defaults to 9090.
#   port connect: If True, connects to ROS. If False, disconnects from ROS. Defaults to False.
#   port ros_client: The ROS client.
#   port is_connected: True if connection established.
# ---------- ros: Python ----------
"""
Connect or disconnect to ROS.

COMPAS FAB v0.19.1
"""
from ghpythonlib.componentbase import executingcomponent as component
from scriptcontext import sticky as st

from compas_fab.backends import RosClient
from compas_fab.ghpython.components import create_id


class ROSConnect(component):
    def RunScript(self, ip, port, connect):
        ros_client = None

        ip = ip or '127.0.0.1'
        port = port or 9090

        key = create_id(self, 'ros_client')
        ros_client = st.get(key, None)

        if ros_client:
            st[key].close()
        if connect:
            st[key] = RosClient(ip, port)
            st[key].run(5)

        ros_client = st.get(key, None)
        is_connected = ros_client.is_connected if ros_client else False
        return (ros_client, is_connected)
# ---------- end ros ----------
robot = ROSRobot(ros_client=ros.ros_client, load=load_robot)  # -> robot; inputs load: Boolean
#   port ros_client: The ROS client.
#   port load: If True, loads the robot from ROS. Defaults to False.
# ---------- robot: Python ----------
"""
Load robot directly from ROS.

COMPAS FAB v0.19.1
"""
from compas_ghpython.artists import RobotModelArtist
from ghpythonlib.componentbase import executingcomponent as component
from scriptcontext import sticky as st

from compas_fab.ghpython.components import create_id


class ROSRobot(component):
    def RunScript(self, ros_client, load):
        key = create_id(self, 'robot')

        if ros_client and ros_client.is_connected and load:
            # Load URDF from ROS
            st[key] = ros_client.load_robot(load_geometry=True, precision='12f')
            st[key].artist = RobotModelArtist(st[key].model)

        robot = st.get(key, None)
        if robot:  # client sometimes need to be restarted, without needing to reload geometry
            robot.client = ros_client
        return robot
# ---------- end robot ----------

# ----
# Tool
attach = BooleanToggle(True)
z_offset = Slider(0.07, range=-0.1..0.2)
attach_tool = GhPythonScript(robot=robot, attached=attach, z_offset=z_offset)  # -> tool_at_origin
# ---------- attach_tool: Python ----------
import os
from compas.geometry import Frame
from compas.datastructures import Mesh
from compas_fab.robots import PlanningScene
from compas_fab.robots import Tool
from compas_ghpython.artists import MeshArtist

HERE = os.path.dirname(ghenv.Component.OnPingDocument().FilePath)

# create tool from mesh and frame
mesh = Mesh.from_stl(os.path.join(HERE, 'vacuum_gripper.stl'))
frame = Frame([z_offset, 0, 0], [0, 0, 1], [0, 1, 0])
tool = Tool(mesh, frame, name='vacuum_gripper')
tool_at_origin = MeshArtist(mesh).draw()

if robot and robot.client and robot.client.is_connected:
    scene = PlanningScene(robot)
    if attached:
        robot.attach_tool(tool)
        scene.add_attached_tool()
    else:
        if robot.attached_tool:
            scene.remove_attached_tool()
            scene.remove_collision_mesh('attached_tool_link_collision_0')
            robot.detach_tool()
# ---------- end attach_tool ----------

# ----
# Home
number_slider = Slider(1.57, range=-3.14..3.14)
home_config = GhPythonScript(j=[number_slider, Slider(-1.57, range=-3.14..3.14), Slider(1.57, range=-3.14..3.14), Slider(-1.57, range=-3.14..3.14), Slider(-1.57, range=-3.14..3.14), Slider(3.14, range=-3.14..3.14)])  # -> config; inputs j: list
# ---------- home_config: Python ----------
from compas.robots import Configuration

config = Configuration.from_revolute_values(j)
# ---------- end home_config ----------

# ----
# Approach offset
approach_offset = Slider(0.05, range=0..0.2)

# ----
# Pick
pt = Point(Point(-0.06432690563, 0.6685124513, 0.08173572512))
t0cf = T0CF(tcf_frame=pt, z_offset=z_offset)

# ----
# Element
number_slider_2 = Slider(0.04, range=0.01..0.05)
number_slider_3 = Slider(0.2, range=0.01..0.35)
number_slider_4 = Slider(0.02, range=0.01..0.05)
python = GhPythonScript(h=number_slider_2, w=number_slider_3, d=number_slider_4)  # -> shape, brick, mesh
# ---------- python: Python ----------
from compas.geometry import Box
from compas.datastructures import Mesh
from compas_ghpython.artists import MeshArtist

shape = Box.from_width_height_depth(w, h, d)
brick = Mesh.from_shape(shape)

mesh = MeshArtist(brick).draw()
# ---------- end python ----------

gene_pool = GenePool(Decimals=2, Maximum=1, Minimum=0, Value=[0, 0.26, 0.5, 0.69, 0.91])
unit_z = UnitZ(Factor=gene_pool)
gene_pool_2 = GenePool(Decimals=2, Maximum=1, Minimum=0, Value=[0.46, 0.61, 0.48, 0.63, 0.55])
gene_pool_3 = GenePool(Decimals=2, Maximum=1, Minimum=0, Value=[0.63, 0.74, 0.59, 0.67, 0.66])
gene_pool_4 = GenePool(Decimals=2, Maximum=1, Minimum=0, Value=[0.44, 0.42, 0.49, 0.73, 0.62])
xy_plane = XYPlane(Origin=unit_z)
negative = Negative(Value=gene_pool_4)
number_slider_5 = Slider(11, range=0..100)
rotate_plane = RotatePlane(Plane=xy_plane, Angle=gene_pool_4)
rotate_plane_2 = RotatePlane(Plane=xy_plane, Angle=negative)
circle = Circle(Plane=rotate_plane, Radius=gene_pool_3)
circle_2 = Circle(Plane=rotate_plane_2, Radius=gene_pool_2)
bounds = Bounds(Numbers=unit_z)
divide_curve = DivideCurve(Curve=circle, Count=number_slider_5, Kinks=False)  # -> simplify(Points), Tangents, Parameters
divide_curve_2 = DivideCurve(Curve=circle_2, Count=number_slider_5, Kinks=False)  # -> simplify(Points), Tangents, Parameters
deconstruct_domain = DeconstructDomain(Domain=bounds)  # -> Start, End
brick_height = Panel(number_slider_2)
flip_matrix = FlipMatrix(Data=divide_curve.Points)
division = Division(A=deconstruct_domain.End, B=brick_height)
flip_matrix_2 = FlipMatrix(Data=divide_curve_2.Points)
series = Series(Start=0, Step=brick_height, Count=division)
polyline = PolyLine(Vertices=flip_matrix, Closed=False)
polyline_2 = PolyLine(Vertices=flip_matrix_2, Closed=False)
unit_z_2 = UnitZ(Factor=series)
xy_plane_2 = XYPlane(Origin=unit_z_2)
curve_plane = CurvePlane(Curve=flatten([polyline_2, polyline]), Plane=graft(xy_plane_2))  # -> simplify(Points), ParamsC, ParamsP
shift_paths = ShiftPaths(Data=curve_plane.Points, Offset=-1)
xy_plane_3 = XYPlane(Origin=shift_paths)
flip_matrix_3 = FlipMatrix(Data=xy_plane_3)
list_length = ListLength(List=flip_matrix_3)
multiplication = Multiplication(A="360", B=Slider(6.4, range=0..10))
construct_domain = ConstructDomain(DomainStart=0, DomainEnd=multiplication)
list_length_2 = ListLength(List=flatten(xy_plane_2))
construct_domain_2 = ConstructDomain(DomainStart="5", DomainEnd=list_length_2)
range = Range(Domain=construct_domain, Steps=expr("x-1", list_length))
rotate_plane_3 = RotatePlane(Plane=flip_matrix_3, Angle=degrees(range))  # -> simplify(Plane)
list_item = ListItem(List=rotate_plane_3, Index=0, Wrap=True)
list_length_3 = ListLength(List=flatten(list_item))
random = Random(Range=construct_domain_2, Number=list_length_3, Seed=2)  # -> simplify(graft(Random))
split_list = SplitList(List=rotate_plane_3, Index=random)  # -> ListA, ListB
flip_matrix_4 = FlipMatrix(Data=simplify(split_list.ListA))  # -> graft(Data)
center_box = CenterBox(Base=rotate_plane_3, X=expr("x/2", number_slider_3), Y=expr("x/2", number_slider_4), Z=expr("x/2", number_slider_2))  # disabled
deconstruct_plane = DeconstructPlane(Plane=flip_matrix_4)  # -> Origin, XAxis, YAxis, ZAxis
amplitude = Amplitude(Vector=deconstruct_plane.YAxis, Amplitude=Slider(0.03, range=0..0.1))
negative_2 = Negative(Value=amplitude)
move = Move(Geometry=flip_matrix_4, Motion=[amplitude, negative_2])  # -> Geometry, Transform
plane = Plane(flatten(move.Geometry))
clean_tree = CleanTree(RemoveNulls=True, RemoveInvalid=True, RemoveEmpty=False, Tree=plane)
python_2 = GhPythonScript(planes=clean_tree, shape=python.shape)  # -> assembly; inputs planes: list; disabled
# ---------- python_2: Python ----------
from compas.datastructures import Mesh
from compas.geometry import Translation
from compas.geometry import Vector
from compas.geometry import Frame

import os
import sys
HERE = os.path.dirname(ghenv.Component.OnPingDocument().FilePath)
if HERE not in sys.path: sys.path.append(HERE)

## Start assembly definition
from assembly import Assembly
from assembly import Element

assembly = Assembly()
assembly.attributes['element'] = shape

key = 0

for k in range(0,len(planes)):
    point = planes[k][0]
    tangent = planes[k][1]
    yaxis = planes[k][2]
    frame = Frame(point, tangent, yaxis)
    element = Element(frame=frame, geometry_at_origin=Mesh.from_shape(shape))
    assembly.add_element(element, key)
    key += 1
# ---------- end python_2 ----------
python_3 = GhPythonScript(
    planes=clean_tree,
    shape=python.shape,
    home_config=home_config,
    pick_t0cf_frame=t0cf,
    approach_offset=approach_offset,
    place_tolerance=0.008)  # -> assembly; inputs planes: list
# ---------- python_3: Python ----------
from compas.datastructures import Mesh
from compas.geometry import Translation
from compas.geometry import Vector
from compas.geometry import Frame

import os
import sys
HERE = os.path.dirname(ghenv.Component.OnPingDocument().FilePath)
if HERE not in sys.path: sys.path.append(HERE)

## Start assembly definition
from assembly import Assembly
from assembly import Element
from compas_fab.ghpython.components import coerce_frame

assembly = Assembly()
assembly.attributes['home_config'] = home_config
assembly.attributes['element'] = shape
assembly.attributes['place_tolerance'] = place_tolerance
assembly.approach_offset = approach_offset
assembly.pick_t0cf_frame = coerce_frame(pick_t0cf_frame)

key = 0

for k in range(0,len(planes)):
    point = planes[k][0]
    tangent = planes[k][1]
    yaxis = planes[k][2]
    frame = Frame(point, tangent, yaxis)
    approach_t0cf_frame = frame.transformed(Translation.from_vector([0, 0, approach_offset]))
    element = Element(frame=frame,
                      approach_frame=approach_t0cf_frame,
                      geometry_at_origin=Mesh.from_shape(shape))
    assembly.add_element(element, key)
    key += 1
# ---------- end python_3 ----------
python_4 = GhPythonScript(assembly=python_3)  # -> elements
# ---------- python_4: Python ----------
from compas_fab.robots import JointTrajectory
from compas_ghpython.artists import FrameArtist
from compas_ghpython.artists import MeshArtist
#from helpers import traversal_buildup_sequence
#from helpers import traversal_breadth_first_ordering
from helpers import traversal_linearly_ordered


elements = []
for j, n in enumerate(traversal_linearly_ordered(assembly)):
    print j
    geom = assembly.element(n).geometry_at_placement
    mesh = MeshArtist(geom).draw()
    elements.append(mesh)

    fa = FrameArtist(assembly.element(n).frame, scale=.02)
    a = fa.draw()
    elements.append(a)
# ---------- end python_4 ----------
list_item_2 = ListItem(List=clean_tree, Index=0, Wrap=True)  # -> Item, Item1, Item2
python_5 = GhPythonScript(assembly=python_3, filename="assembly.json", write=Toggle(False))
# ---------- python_5: Python ----------
# Mac will not automatically do this so, here we go
import os
import sys
HERE = os.path.dirname(ghenv.Component.OnPingDocument().FilePath)
if HERE not in sys.path: sys.path.append(HERE)
import compas


if write:
    # Save assembly
    compas.json_dump(assembly, os.path.join(HERE, filename), pretty=True)
# ---------- end python_5 ----------

pt_2 = Point(Point(0.3265536804, -0.1109182647, 0))
pt_3 = Point(Point(0.2157134479, 0.001329246688, 0))
pt_4 = Point(Point(0.4439170338, 0.09527581449, 0))
pt_5 = Point(Point(0.3236795852, 0.1949461524, 0))
shape = Data(python.shape)
number_slider_6 = Slider(0.0005, range=0..0.001)
num_bricks_per_row = Slider(9, range=0..100)
pt_6 = Point([pt_2, pt_3, pt_4, pt_5])
python_6 = GhPythonScript(points=pt_6, shape=shape, num_rows=Slider(9, range=0..10), tolerance_height=number_slider_6)  # -> curves; inputs points: list, num_rows: Int32
# ---------- python_6: Python ----------
import Rhino.Geometry as rg
from compas.geometry import project_points_line

height = shape.zsize

ptS, ptA, ptB, ptE = points
line = ptS, ptE
ptAj, ptBj = project_points_line([ptA, ptB], line)
ptAj, ptBj = rg.Point3d(*ptAj), rg.Point3d(*ptBj)
stepA = (ptAj - ptA)/(num_rows - 1)
stepB = (ptBj - ptB)/(num_rows - 1)
up = rg.Vector3d(0, 0, height + tolerance_height)

curves = []
for i, r in enumerate(range(num_rows)):
    crv = rg.Curve.CreateControlPointCurve(points, 3)
    curves.append(crv)
    points = [p + up for p in points]
    points[1] += stepA
    points[2] += stepB
# ---------- end python_6 ----------
python_7 = GhPythonScript(curves=python_6, num_bricks=num_bricks_per_row, shape=shape)  # -> assembly; inputs curves: list, num_bricks: Int32
# ---------- python_7: Python ----------
from compas.datastructures import Mesh
from compas.geometry import Translation
from compas.geometry import Vector
from compas.geometry import Frame

import os
import sys
HERE = os.path.dirname(ghenv.Component.OnPingDocument().FilePath)
if HERE not in sys.path: sys.path.append(HERE)

## Start assembly definition
from assembly import Assembly
from assembly import Element

assembly = Assembly()
assembly.attributes['element'] = shape

key = 0

for k, crv in enumerate(curves):
    length = crv.GetLength()
    if k % 2 == 0:
        ts = crv.LengthParameter(shape.width/2)[1]
        te = crv.LengthParameter(length - shape.width/2)[1]
        params = crv.Trim(ts, te).DivideByCount(num_bricks - 1, True)
    else:
        params = crv.DivideByCount(num_bricks, True)
        params[0] = crv.LengthParameter(shape.depth/2)[1]
        params[-1] = crv.LengthParameter(length - shape.depth/2)[1]

    for j, t in enumerate(params):
        x, y, z = 0, 0, (shape.height / 2)
        point = crv.PointAt(t)
        tangent = crv.TangentAt(t)
        yaxis = Vector(0,0,1).cross(tangent)
        
        if k % 2 == 1 and j in [0, len(params) - 1]:
            frame = Frame(point, yaxis, -tangent)
        else:
            frame = Frame(point, tangent, yaxis)

        frame = frame.transformed(Translation.from_vector([x, y, z]))
        element = Element(frame=frame, geometry_at_origin=Mesh.from_shape(shape))
        assembly.add_element(element, key)
        key += 1
# ---------- end python_7 ----------

pt_7 = Point(Point(0.320019137, -0.2407715452, 0))
shape_2 = Data(python.shape)
python_8 = GhPythonScript(
    point=pt_7,
    shape=shape_2,
    num_rows=Slider(9, range=0..10),
    tolerance_height=number_slider_6,
    offset=Slider(0.002, range=0..0.01))  # -> assembly; inputs num_rows: Int32
# ---------- python_8: Python ----------
from compas.datastructures import Mesh
from compas.geometry import Translation
from compas.geometry import Vector
from compas.geometry import Point
from compas.geometry import Frame
import Rhino.Geometry as rg

import os
import sys
HERE = os.path.dirname(ghenv.Component.OnPingDocument().FilePath)
if HERE not in sys.path: sys.path.append(HERE)

## Start assembly definition
from assembly import Assembly
from assembly import Element

assembly = Assembly()
assembly.attributes['element'] = shape

key = 0

for row in range(num_rows):
    
    x, y, z = 0, 0, (shape.height / 2)
    
    p = Point(*list(point))
    p.z = row * (shape.height + tolerance_height)
    
    if row % 2 == 0:
        v = Vector(1, 0, 0)
        xaxis = Vector(0, 1, 0)
        yaxis = Vector(-1, 0, 0)
    else:
        v = Vector(0, 1, 0)
        xaxis = Vector(1, 0, 0)
        yaxis = Vector(0, 1, 0)
        
    pointA = p - v * (shape.depth/2 + offset)
    pointB = p + v * (shape.depth/2 + offset)
    frameA = Frame(pointA, xaxis, yaxis)
    frameB = Frame(pointB, xaxis, yaxis)
    
    for frame in [frameA, frameB]:
        frame = frame.transformed(Translation.from_vector([x, y, z]))
        element = Element(frame=frame, geometry_at_origin=Mesh.from_shape(shape))
        assembly.add_element(element, key)
        key += 1
# ---------- end python_8 ----------

panel = Panel(python_4)

num_bricks_per_row_2 = Slider(8, range=0..100)
crv = Curve(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)
python_9 = GhPythonScript(
    curves=crv,
    num_bricks=num_bricks_per_row_2,
    shape=shape,
    home_config=home_config,
    pick_t0cf_frame=t0cf,
    approach_offset=approach_offset,
    place_tolerance=0.008)  # -> assembly; inputs curves: list, num_bricks: Int32
# ---------- python_9: Python ----------
from compas.datastructures import Mesh
from compas.geometry import Translation
from compas.geometry import Vector
from compas.geometry import Frame

import os
import sys
HERE = os.path.dirname(ghenv.Component.OnPingDocument().FilePath)
if HERE not in sys.path: sys.path.append(HERE)

## Start assembly definition
from assembly import Assembly
from assembly import Element
from compas_fab.ghpython.components import coerce_frame

assembly = Assembly()
assembly.attributes['home_config'] = home_config
assembly.attributes['element'] = shape
assembly.attributes['place_tolerance'] = place_tolerance
assembly.approach_offset = approach_offset
assembly.pick_t0cf_frame = coerce_frame(pick_t0cf_frame)

key = 0

for k, crv in enumerate(curves):
    length = crv.GetLength()
    if k % 2 == 0:
        ts = crv.LengthParameter(shape.width/2)[1]
        te = crv.LengthParameter(length - shape.width/2)[1]
        params = crv.Trim(ts, te).DivideByCount(num_bricks - 1, True)
    else:
        params = crv.DivideByCount(num_bricks, True)
        params[0] = crv.LengthParameter(shape.depth/2)[1]
        params[-1] = crv.LengthParameter(length - shape.depth/2)[1]

    for j, t in enumerate(params):
        x, y, z = 0, 0, (shape.height / 2)
        point = crv.PointAt(t)
        tangent = crv.TangentAt(t)
        yaxis = Vector(0,0,1).cross(tangent)
        
        if k % 2 == 1 and j in [0, len(params) - 1]:
            frame = Frame(point, yaxis, -tangent)
        else:
            frame = Frame(point, tangent, yaxis)

        frame = frame.transformed(Translation.from_vector([x, y, z]))
        element = Element(frame=frame, geometry_at_origin=Mesh.from_shape(shape))
        assembly.add_element(element, key)
        key += 1
# ---------- end python_9 ----------

# ----
# Example assemblies
number_slider_7 = Slider(2, range=0..2)
filter = StreamFilter(Gate=number_slider_7, Stream0=python_7, Stream1=python_8, Stream2=python_9)
python_10 = GhPythonScript(assembly=filter)  # -> elements; disabled; same code as python_4
python_11 = GhPythonScript(filename="assembly.json", write=Toggle(True))  # disabled; same code as python_5

crv_2 = Curve(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)  # disabled
crv_3 = Curve(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)  # disabled
crv_4 = Curve(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)  # disabled
crv_5 = Curve(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)  # disabled
crv_6 = Curve(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)  # disabled
crv_7 = Curve(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)  # disabled
divide = DivideCurve(Curve=crv_2, Count=20, Kinks=False)  # -> Points, Tangents, Parameters; disabled
divide_2 = DivideCurve(Curve=crv_3, Count=20, Kinks=False)  # -> Points, Tangents, Parameters; disabled
divide_3 = DivideCurve(Curve=crv_4, Count=20, Kinks=False)  # -> Points, Tangents, Parameters; disabled
divide_4 = DivideCurve(Curve=crv_7, Count=20, Kinks=False)  # -> Points, Tangents, Parameters; disabled
divide_5 = DivideCurve(Curve=crv_5, Count=20, Kinks=False)  # -> Points, Tangents, Parameters; disabled
divide_6 = DivideCurve(Curve=crv_6, Count=20, Kinks=False)  # -> Points, Tangents, Parameters; disabled
t0cf_2 = T0CF(tcf_frame=divide.Points, z_offset=z_offset)  # disabled
t0cf_3 = T0CF(tcf_frame=divide_2.Points, z_offset=z_offset)  # disabled
t0cf_4 = T0CF(tcf_frame=divide_3.Points, z_offset=z_offset)  # disabled
t0cf_5 = T0CF(tcf_frame=divide_4.Points, z_offset=z_offset)  # disabled
t0cf_6 = T0CF(tcf_frame=divide_5.Points, z_offset=z_offset)  # disabled
t0cf_7 = T0CF(tcf_frame=divide_6.Points, z_offset=z_offset)  # disabled
panel_2 = Panel(python_10)
relay = Relay([t0cf_2, t0cf_3, t0cf_4, t0cf_5, t0cf_6, t0cf_7])  # disabled

# ----
# Element
number_slider_8 = Slider(0.012, range=0.01..0.05)  # disabled
number_slider_9 = Slider(0.031, range=0.01..0.05)  # disabled
number_slider_10 = Slider(0.016, range=0.01..0.05)  # disabled
python_12 = GhPythonScript(h=number_slider_8, w=number_slider_9, d=number_slider_10)  # -> shape, brick, mesh; disabled; same code as python

# ----
# Assembly
update_assembly = GhPythonScript(
    robot=robot,
    pick_t0cf_frame=t0cf,
    place_t0cf_frames=relay,
    approach_offset=approach_offset,
    element=python_12.shape,
    home_config=home_config,
    place_tolerance=0.008)  # -> assembly, pickup_t0cf_frames; inputs place_t0cf_frames: list; disabled
# ---------- update_assembly: Python ----------
# Mac will not automatically do this so, here we go
import os
import sys
HERE = os.path.dirname(ghenv.Component.OnPingDocument().FilePath)
if HERE not in sys.path: sys.path.append(HERE)

## Start assembly definition
from assembly import Assembly
from assembly import Element

from compas.datastructures import Mesh
from compas.geometry import Translation
from compas_fab.ghpython.components import coerce_frame


assembly = Assembly()

assembly.attributes['home_config'] = home_config
assembly.attributes['element'] = element
assembly.attributes['place_tolerance'] = place_tolerance
assembly.approach_offset = approach_offset

source_element = assembly.attributes['element']
assembly.pick_t0cf_frame = coerce_frame(pick_t0cf_frame)
place_t0cf_frames = [coerce_frame(f) for f in place_t0cf_frames]

for key, frame in enumerate(robot.from_t0cf_to_tcf(place_t0cf_frames)):
    x, y, z = 0, 0, (source_element.height / 2)

    frame = frame.transformed(Translation.from_vector([x, y, z]))
    approach_t0cf_frame = frame.transformed(Translation.from_vector([0, 0, approach_offset]))
    element = Element(frame=frame,
                      approach_frame=approach_t0cf_frame,
                      geometry_at_origin=Mesh.from_shape(source_element))
    assembly.add_element(element, key)

pickup_t0cf_frames = assembly.pick_t0cf_frames()
# ---------- end update_assembly ----------

# ----
# Static objects
mesh = Mesh(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)  # disabled
python_13 = GhPythonScript(robot=robot, meshes=mesh)  # inputs meshes: list; disabled
# ---------- python_13: Python ----------
import os
from compas.geometry import Frame
from compas.datastructures import Mesh
from compas_fab.robots import PlanningScene
from compas_fab.robots import CollisionMesh
from compas_ghpython.artists import MeshArtist
from compas_rhino.geometry import RhinoMesh

if robot and robot.client and robot.client.is_connected:
    static_cm_name = 'static_objects'
    scene = PlanningScene(robot)
    scene.remove_collision_mesh(static_cm_name)
    if meshes:
        for mesh in meshes:
            mesh = RhinoMesh.from_guid(mesh).to_compas()
            cm = CollisionMesh(mesh, static_cm_name)
            scene.append_collision_mesh(cm)
# ---------- end python_13 ----------

update_assembly_2 = GhPythonScript(
    robot=robot,
    pick_t0cf_frame=t0cf,
    place_t0cf_frames=relay,
    approach_offset=approach_offset,
    element=python_12.shape,
    home_config=home_config,
    place_tolerance=0.008)  # -> assembly, pickup_t0cf_frames; inputs place_t0cf_frames: list; disabled; same code as update_assembly

# ----
# Cartesian pickup plan
button = Button()
# SOLVE
plan_cartesian_motion = PlanCartesianMotion(robot=robot, assembly=python_3, compute=button)  # -> trajectory; inputs attached_collision_meshes: list, path_constraints: list, compute: Boolean
# ---------- plan_cartesian_motion: Python ----------
from ghpythonlib.componentbase import executingcomponent as component
from scriptcontext import sticky as st

from compas_fab.ghpython.components import coerce_frame
from compas_fab.ghpython.components import create_id


class PlanCartesianMotion(component):
    def RunScript(self, robot, assembly, group, attached_collision_meshes, path_constraints, max_step, compute):

        key = create_id(self, 'trajectory')
        start_configuration = assembly.attributes['home_config']
        planes = assembly.pick_t0cf_frames()

        max_step = float(max_step) if max_step else 0.01
        path_constraints = list(path_constraints) if path_constraints else None
        attached_collision_meshes = list(attached_collision_meshes) if attached_collision_meshes else None

        if robot and robot.client and robot.client.is_connected and start_configuration and planes and compute:
            frames = [coerce_frame(plane) for plane in planes]
            st[key] = robot.plan_cartesian_motion(frames,
                                                  start_configuration=start_configuration,
                                                  group=group,
                                                  options=dict(
                                                      max_step=max_step,
                                                      path_constraints=path_constraints,
                                                      attached_collision_meshes=attached_collision_meshes
                                                  ))

        trajectory = st.get(key, None)
        assembly.pick_trajectory = trajectory
        return trajectory
# ---------- end plan_cartesian_motion ----------
trajectory_visualize = TrajectoryVisualize(robot=robot, trajectory=plan_cartesian_motion)  # -> start_configuration, configurations, fraction, time, planes, P, V, A
#   port group: The planning group for which this trajectory was planned.
#   port trajectory: The calculated trajectory.
#   port start_configuration: The start configuration of the trajectory.
#   port configurations: The full configurations along the trajectory.
#   port fraction: Indicates the fraction of requested trajectory that was calculated, e.g. 1 means the full trajectory was found.
#   port time: The time which is needed to execute that trajectory at full speed.
#   port planes: The planes of the robot's end-effector.
#   port P: The positions along the trajectory
#   port V: The velocities along the trajectory
#   port A: The accelerations along the trajectory
# ---------- trajectory_visualize: Python ----------
"""
Visualizes a trajectory.

COMPAS FAB v0.19.1
"""
from compas_ghpython import draw_frame
from compas_ghpython import list_to_ghtree
from ghpythonlib.componentbase import executingcomponent as component


class TrajectoryVisualize(component):
    def RunScript(self, robot, group, trajectory):
        start_configuration = None
        configurations = []
        fraction = 0.
        time = 0.

        planes = []
        positions = []
        velocities = []
        accelerations = []

        if robot and trajectory:
            group = group or robot.main_group_name

            for c in trajectory.points:
                configurations.append(robot.merge_group_with_full_configuration(c, trajectory.start_configuration, group))
                frame = robot.forward_kinematics(c, group, options=dict(solver='model'))
                planes.append(draw_frame(frame))
                positions.append(c.positions)
                velocities.append(c.velocities)
                accelerations.append(c.accelerations)

            start_configuration = trajectory.start_configuration
            fraction = trajectory.fraction
            time = trajectory.time_from_start

        P = list_to_ghtree(list(zip(*positions)))
        V = list_to_ghtree(list(zip(*velocities)))
        A = list_to_ghtree(list(zip(*accelerations)))

        # return outputs if you have them; here I try it for you:
        return (start_configuration, configurations, fraction, time, planes, P, V, A)
# ---------- end trajectory_visualize ----------

store = GhPythonScript()
# ---------- store: Python ----------
if assembly:
    assembly.pick_trajectory = pick_trajectory
# ---------- end store ----------

# ----
# Save to JSON
button_2 = Button()
save = GhPythonScript(assembly=filter, save=button_2)  # -> out, a; disabled
# ---------- save: Python ----------
import os
import json
import compas

HERE = os.path.dirname(ghenv.Component.OnPingDocument().FilePath)
rfile = os.path.join(HERE, 'assembly.json')

# We are storing a full assembly representation
if save and assembly:
    compas.json_dump(assembly, rfile, pretty=True)
# ---------- end save ----------

# ----
# Placement plan
number_slider_11 = Slider(7, range=0..100)

prepare_scene = GhPythonScript(robot=robot, assembly=python_3, i=number_slider_11)  # -> assembly
# ---------- prepare_scene: Python ----------
from compas.datastructures import Mesh
from compas_fab.robots import AttachedCollisionMesh
from compas_fab.robots import CollisionMesh
from compas_fab.robots import PlanningScene


if robot:
    scene = PlanningScene(robot)
    scene.remove_collision_mesh('built_elements')

    a = []
    for key in assembly.nodes():
        # Linear order assumed here!
        if key >= i: break
        element = assembly.element(key)
        cm = CollisionMesh(element.geometry_at_placement, 'built_elements')
        scene.append_collision_mesh(cm)

    # Setup attached element
    scene.remove_attached_collision_mesh('brick')
    scene.remove_collision_mesh('brick')

    ee_link_name = robot.get_end_effector_link_name()
    if robot.attached_tool:
        brick_frame = robot.attached_tool.frame.copy()
    else:
        brick_frame = Frame.worldXY()

    # Centered origin, get half
    element = assembly.attributes['element']
    brick_frame.point.x += element.height / 2
    element = Mesh.from_shape(element)
    brick_acm = AttachedCollisionMesh(CollisionMesh(element, 'brick', brick_frame), ee_link_name)
    scene.add_attached_collision_mesh(brick_acm)
# ---------- end prepare_scene ----------

plan_trajectory = GhPythonScript(robot=robot, assembly=prepare_scene, i=number_slider_11, compute=Button())  # -> trajectory, place_trajectory
# ---------- plan_trajectory: Python ----------
import math
from compas.geometry import Frame
from compas.geometry import Transformation
from compas.geometry import Translation
from compas_ghpython.artists import MeshArtist
from compas.robots import Configuration
from compas_fab.robots import PlanningScene
from compas_fab.robots import AttachedCollisionMesh
from compas_fab.robots import CollisionMesh
from compas_fab.ghpython.components import coerce_frame
from scriptcontext import sticky as st

key = '{}_{}'.format('trajectory', ghenv.Component.InstanceGuid)
place_key = '{}_{}'.format('place_trajectory', ghenv.Component.InstanceGuid)

if robot and compute:
    start_configuration = robot.zero_configuration()
    if assembly.pick_trajectory:
        start_configuration.joint_values = assembly.pick_trajectory.points[-1].joint_values

    e = assembly.element(i)
    place_t0cf_frame, approach_t0cf_frame = robot.from_tcf_to_t0cf([e.frame, e.approach_frame])
    
    # Apply place tolerance
    x, y, z = 0, 0, assembly.attributes['place_tolerance']
    place_t0cf_frame = place_t0cf_frame.transformed(Translation.from_vector([x, y, z]))

    tolerance_position = 0.001
    tolerance_axes = [math.radians(1)] * 3

    # create goal constraints from frame
    goal_constraints = robot.constraints_from_frame(approach_t0cf_frame,
                                                    tolerance_position,
                                                    tolerance_axes,
                                                    group)

    trajectory = robot.plan_motion(goal_constraints,
                                   start_configuration,
                                   group,
                                   options=dict(planner_id='RRTstarkConfigDefault'))

    frames = []
    frames.append(approach_t0cf_frame)
    frames.append(place_t0cf_frame)

    start_configuration = robot.zero_configuration()
    start_configuration.joint_values = trajectory.points[-1].joint_values

    place_trajectory = robot.plan_cartesian_motion(frames,
                                                   start_configuration,
                                                   group=group,
                                                   options=dict(
                                                       max_step=0.01,
                                                       avoid_collisions=True,
                                                   ))

    if place_trajectory and place_trajectory.fraction < 1.0:
        raise Exception('Incomplete trajectory. Fraction={}'.format(place_trajectory.fraction))

#    scene.remove_attached_collision_mesh('brick')
#    scene.remove_collision_mesh('brick')

    st[key] = trajectory
    st[place_key] = place_trajectory

    # Merge and store
    e.trajectory = trajectory.points + place_trajectory.points + list(reversed(place_trajectory.points)) + list(reversed(trajectory.points))

trajectory = st.get(key)
place_trajectory = st.get(place_key)
# ---------- end plan_trajectory ----------
place_trajectory = TrajectoryVisualize(robot=robot, trajectory=plan_trajectory.place_trajectory)  # -> start_configuration, configurations, fraction, time, planes, P, V, A; same code as trajectory_visualize
move_trajectory = TrajectoryVisualize(robot=robot, trajectory=plan_trajectory.trajectory)  # -> start_configuration, configurations, fraction, time, planes, P, V, A; same code as trajectory_visualize
merge_trajectories = GhPythonScript(pick=plan_cartesian_motion, move=plan_trajectory.trajectory, place=plan_trajectory.place_trajectory)  # -> configurations
# ---------- merge_trajectories: Python ----------
configurations = pick.points + move.points + place.points + list(reversed(place.points)) + list(reversed(move.points))
# ---------- end merge_trajectories ----------

# ----
# Visualization
list = ValueList({"Home config": 0, "Cartesian pickup": 1, "Move trajectory": 2, "Cartesian place": 3, "Merged trajectory": 4, "Approach frame": 5, "Place frame": 6}, selected="Merged trajectory")
select = StreamFilter(
    Gate=list,
    Stream0=home_config,
    Stream1=trajectory_visualize.configurations,
    Stream2=move_trajectory.configurations,
    Stream3=place_trajectory.configurations,
    Stream4=merge_trajectories)
reload = BooleanToggle(True)

item = ListItem(List=select, Index=Slider(0, range=0..200), Wrap=True)

# ----
# OUTPUT
visualize = GhPythonScript(robot=robot, configuration=item, reload_scene=reload)  # -> visual, frames, attached_collision_meshes, collision_meshes
# ---------- visualize: Python ----------
import Grasshopper
import System
from ghpythonlib.componentbase import executingcomponent as component
from scriptcontext import sticky as st

from compas.geometry import Frame
from compas.geometry import Transformation
from compas_ghpython.artists import MeshArtist
from compas_ghpython import draw_frame
from compas_fab.ghpython.components import create_id

class RobotVisualize(component):
    def SetUpParam(self, p, name, nickname, description):
        p.Name = name
        p.NickName = nickname
        p.Description = description
        p.Optional = True

    def RegisterInputParams(self, pManager):
        p = Grasshopper.Kernel.Parameters.Param_GenericObject()
        self.SetUpParam(p, "robot", "robot", "The robot.")
        p.Access = Grasshopper.Kernel.GH_ParamAccess.item
        self.Params.Input.Add(p)

        p = Grasshopper.Kernel.Parameters.Param_String()
        self.SetUpParam(p, "group", "group", "The planning group used for end-effector and base visualization.")
        p.Access = Grasshopper.Kernel.GH_ParamAccess.item
        self.Params.Input.Add(p)

        p = Grasshopper.Kernel.Parameters.Param_GenericObject()
        self.SetUpParam(p, "configuration", "configuration", "The robot's full configuration.")
        p.Access = Grasshopper.Kernel.GH_ParamAccess.item
        self.Params.Input.Add(p)

        p = Grasshopper.Kernel.Parameters.Param_Boolean()
        self.SetUpParam(p, "reload_scene", "reload_scene", "Whether or not to reload the scene information from the client.")
        p.Access = Grasshopper.Kernel.GH_ParamAccess.item
        self.Params.Input.Add(p)

    def RegisterOutputParams(self, pManager):

        p = Grasshopper.Kernel.Parameters.Param_GenericObject()
        self.SetUpParam(p, "visual", "visual", "The robot's visual meshes.")
        self.Params.Output.Add(p)

        p = Grasshopper.Kernel.Parameters.Param_GenericObject()
        self.SetUpParam(p, "frames", "frames", "The robot's joint frames.")
        self.Params.Output.Add(p)

        p = Grasshopper.Kernel.Parameters.Param_GenericObject()
        self.SetUpParam(p, "attached_collision_meshes", "attached_collision_meshes", "Attached collision meshes in the scene.")
        self.Params.Output.Add(p)

        p = Grasshopper.Kernel.Parameters.Param_GenericObject()
        self.SetUpParam(p, "collision_meshes", "collision_meshes", "Collision meshes in the scene.")
        self.Params.Output.Add(p)

    def SolveInstance(self, DA):
        p0 = self.marshal.GetInput(DA, 0)
        p1 = self.marshal.GetInput(DA, 1)
        p2 = self.marshal.GetInput(DA, 2)
        p3 = self.marshal.GetInput(DA, 3)
        result = self.RunScript(p0, p1, p2, p3)

        if result is not None:
            if not hasattr(result, '__getitem__'):
                self.marshal.SetOutput(result, DA, 0, True)
            else:
                self.marshal.SetOutput(result[0], DA, 0, True)
                self.marshal.SetOutput(result[1], DA, 1, True)
                self.marshal.SetOutput(result[2], DA, 2, True)
                self.marshal.SetOutput(result[3], DA, 3, True)

    def RunScript(self, robot, group, configuration, reload_scene):

        visual = None
        frames = None
        collision_meshes = []
        attached_collision_meshes = []

        if robot:
            configuration = configuration or robot.zero_configuration()

            robot.update(configuration, visual=True, collision=False)
            frames = [draw_frame(f) for f in robot.transformed_frames(configuration, group)]

            visual = robot.artist.draw_visual()

        scene_key = create_id(self, 'scene')

        if robot and (reload_scene or scene_key not in st):
            st[scene_key] = robot.client.get_planning_scene()

        scene = st.get(scene_key, None)

        if scene and robot and robot.client and robot.client.is_connected:

            scene_key_co = scene_key + '_co'
            if reload_scene or scene_key_co not in st:
                for co in scene.world.collision_objects:
                    header = co.header
                    frame_id = header.frame_id
                    cms = co.to_collision_meshes()

                    for cm in cms:
                        if frame_id != '/world':
                            raise NotImplementedException('Only world-referenced collision meshes are supported')

                        if cm.frame != Frame.worldXY():
                            t = Transformation.from_frame(cm.frame)
                            mesh = cm.mesh.transformed(t)
                        else:
                            mesh = cm.mesh

                        rhino_mesh = MeshArtist(mesh).draw()
                        collision_meshes.append(rhino_mesh)
                st[scene_key_co] = collision_meshes

            collision_meshes = st.get(scene_key_co, None)

            for aco in scene.robot_state.attached_collision_objects:
                for acm in aco.to_attached_collision_meshes():
                    frame_id = aco.object['header']['frame_id']
                    frame = robot.forward_kinematics(configuration, options=dict(link=frame_id))
                    t = Transformation.from_frame(frame)

                    # Local CM frame
                    if acm.collision_mesh.frame and acm.collision_mesh.frame != Frame.worldXY():
                        t = t * Transformation.from_frame(acm.collision_mesh.frame)

                    mesh = acm.collision_mesh.mesh.transformed(t)

                    rhino_mesh = MeshArtist(mesh).draw()
                    attached_collision_meshes.append(rhino_mesh)

        return (visual, frames, attached_collision_meshes, collision_meshes)
# ---------- end visualize ----------

# ==== cluster T0CF
tcf_frame = ClusterInput()
z_offset = ClusterInput()
pln = Plane(tcf_frame)
num = Number(z_offset)

# ----
# Adjust to UR5 frame
xz = XZPlane(Origin=pln)
prot = RotatePlane(Plane=xz, Angle=-1.57)

vec = VectorXYZ(XComponent=0, YComponent=0, ZComponent=num)  # -> Vector, Length
move = Move(Geometry=prot, Motion=vec.Vector)  # -> Geometry, Transform
pln_2 = Plane(move.Geometry)
t0cf_frame = ClusterOutput(pln_2)
